# Grasshopper definition grasshopper commands (graph mapper).gh (Grasshopper 1.0.7)
# plug-ins: Bifocals

unit_y = UnitY(Factor=1)
start = Start(Point(0, 0, 0))
line_sdl = LineSDL(Start=start, Direction=unit_y, Length=Slider(151.04, range=0..1000))
unit_x = UnitX(Factor=Slider(7.6, range=0..10))
number_slider = Slider(72, range=0..100)
linear_array = LinearArray(Geometry=line_sdl, Direction=unit_x, Count=number_slider)  # -> Geometry, Transform
unit_x_2 = UnitX(Factor=1)
point_on_curve = PointOnCurve(linear_array.Geometry, parameter=1)
range = Range(Domain=Domain(0, 1), Steps=expr("x-1", number_slider))
number_slider_2 = Slider(12, range=0..100)
graph_mapper = GraphMapper(range, x0=0, x1=1, y0=0, y1=1, container_name="Sine", Equation_px=[0, 0.2715807855], Equation_py=[0, 0.9791690111])
construct_domain = ConstructDomain(DomainStart=expr("-x", number_slider_2), DomainEnd=number_slider_2)
bounds = Bounds(Numbers=graph_mapper)
remap_numbers = RemapNumbers(Value=graph_mapper, Source=bounds, Target=construct_domain)  # -> Mapped, Clipped
rotate_3d = Rotate3D(Geometry=linear_array.Geometry, Angle=degrees(remap_numbers.Mapped), Center=point_on_curve, Axis=unit_x_2)  # -> Geometry, Transform
unit_z = UnitZ(Factor=Slider(10, range=0..10))
extrude = Extrude(Base=rotate_3d.Geometry, Direction=unit_z)
unit_x_3 = UnitX(Factor=Slider(3, range=0..10))
extrude_2 = Extrude(Base=extrude, Direction=unit_x_3)
brep_edges = BrepEdges(Brep=extrude_2)  # -> Naked, Interior, NonManifold
custom_preview = CustomPreview(Geometry=extrude_2, Material=ColourSwatch(SwatchColor=RGB(0, 0, 130)))
custom_preview_2 = CustomPreview(Geometry=[brep_edges.Naked, brep_edges.Interior], Material=ColourSwatch(SwatchColor=RGB(255, 0, 130)))
