# Grasshopper definition grasshopper commands (random).gh (Grasshopper 1.0.7)
# plug-ins: Bifocals

radians = Radians(Degrees=Slider(271.06, range=0..360))
arc = Arc(Plane=PlaneXY(0, 0, 0), Radius=Slider(59.04, range=0..100), Angle=radians)  # -> Arc, Length
unit_z = UnitZ(Factor=Slider(150, range=0..1000))
extrude = Extrude(Base=arc.Arc, Direction=unit_z)
number_slider = Slider(12, range=0..100)
md_slider = MDSlider(SliderMode=0, slider_value=Point(0.5, 0.5, 0.5), x_domain=Domain(0, 1), y_domain=Domain(0, 1), z_domain=Domain(0, 1))
divide_domain² = DivideDomain²(Domain=extrude, UCount=number_slider, VCount=number_slider)
isotrim = Isotrim(Surface=extrude, Domain=divide_domain²)
construct_domain = ConstructDomain(DomainStart=Slider(2.5, range=0..10), DomainEnd=Slider(10, range=0..10))
evaluate_surface = EvaluateSurface(Surface=reparameterize(isotrim), Point=md_slider)  # -> Point, Normal, UDirection, VDirection, Frame
random = Random(Range=construct_domain, Number=isotrim, Seed=Slider(10, range=0..10))  # -> flatten(Random)
vector = Vector(evaluate_surface.Normal)
multiplication = Multiplication(A=vector, B=random)
extrude_2 = Extrude(Base=isotrim, Direction=multiplication)
