# Grasshopper definition grasshopper commands (sinecosine).gh (Grasshopper 1.0.7)
# plug-ins: Bifocals

series = Series(Start=Slider(0, range=0..15), Step=Slider(1, range=0..1), Count=Slider(58.52, range=0..100))
sine = Sine(Value=series)
construct_point = ConstructPoint(XCoordinate=series, YCoordinate=0, ZCoordinate=sine)
